# Grasshopper definition mainHourly_Classic.gh (Grasshopper 1.0.7)
# plug-ins: MeshEdit Components, Human

# ----
# Input Paramters
panel = Panel("static_facade.json")
datapath = PythonScript(data_file="comb.json")  # -> out, file_path
# ---------- datapath: Python ----------
#import json from python output

import sys, os
import datetime

# assign destination:
file_path = ghenv.Component.OnPingDocument().FilePath
asf_folder = '\\'.join(file_path.split('\\')[0:-1])

file_path = os.path.join(asf_folder , str(data_file))

print file_path
# ---------- end datapath ----------
datapath_2 = PythonScript(data_file="FolderName.json")  # -> out, file_path; same code as datapath
datapath_3 = PythonScript(data_file="building_static.json")  # -> out, file_path; same code as datapath
datapath_4 = PythonScript(data_file=panel)  # -> out, file_path; same code as datapath
read_file = ReadFile(File=datapath_2.file_path, PerLineParse=True)
read_file_2 = ReadFile(File=datapath.file_path, PerLineParse=True)
read_file_3 = ReadFile(File=datapath_3.file_path, PerLineParse=True)
read_file_4 = ReadFile(File=datapath_4.file_path, PerLineParse=True)  # -> Content
#   port File: Uri of file to read
# ---------- read_file_4: VB line parser ----------
    action = GH_LineParserAction.Include
    Return line

    'Parse the line and return some data that represents the line.
    'If the line cannot be parsed, you can return Nothing and
    'assign a different action.
    'The default implementation is to just return the line itself.
    'If you return types that implement IGH_Goo, this component
    'will work substantially faster.
# ---------- end read_file_4 ----------
python_script = PythonScript(FolderName=read_file)  # -> EPW, DataName
# ---------- python_script: Python ----------
import json

FolderName= json.loads(FolderName)

 


DataName = FolderName['DataFolderName']
EPW = FolderName['EPW']



print EPW
# ---------- end python_script ----------

boolean_toggle = BooleanToggle(False)
updateladybug = Ladybug_UpdateLadybug(updateThisFile=boolean_toggle, updateAllUObjects=boolean_toggle)  # -> out; plug-in component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
python_script_2 = PythonScript(x=read_file_2)  # -> out, x_angle, y_angle, hour, combination, month, day
# ---------- python_script_2: Python ----------
import json

x= json.loads(x)

print x


x_angle=x['x_angle']
y_angle=x['y_angle']
hour=x['Hour']
day = x['Day']
month = x['Month']



combination = x_angle + y_angle
# ---------- end python_script_2 ----------
weatherpath = PythonScript(weather_data_file=python_script.EPW)  # -> out, weather_path, location_noSuffix
# ---------- weatherpath: Python ----------
#Save Temperature from .epw weather file

import sys, os
import datetime

# assign destination:
file_path = ghenv.Component.OnPingDocument().FilePath
asf_folder = '\\'.join(file_path.split('\\')[0:-2])

weather_path = os.path.join(asf_folder + "\WeatherData", str(weather_data_file))

#remove last four letters(suffix) from name = '.epw'  
location_noSuffix = weather_data_file[:-4]

print weather_path
print location_noSuffix
# ---------- end weatherpath ----------
panel_2 = Panel(python_script.DataName)
python_script_3 = PythonScript(hour=python_script_2.hour, day=python_script_2.day, month=python_script_2.month)  # -> fromHour, toHour, fromDay, toDay, fromMonth, toMonth; inputs hour: Int32, month: Int32
# ---------- python_script_3: Python ----------
import json


print hour, day, month


_fromHour_ = hour
_toHour_ = hour + 1

_fromDay_ = day
_toDay_ = day

_fromMonth_ = month
_toMonth_ = month
# ---------- end python_script_3 ----------
python_script_4 = PythonScript(x=read_file_4)  # -> out, XANGLESjson, YANGLESjson, NoClusters, numberHorizontal, numberVertical, panelOffset, panelSize, panelSpacing, panelGridSize
# ---------- python_script_4: Python ----------
import json

x= json.loads(x) #json.loads(): parse JSON string and convert it to Python Dictionary

print x

XANGLESjson= json.dumps(x['XANGLES']) #json.dumps(): converts Python object into json string
YANGLESjson= json.dumps(x['YANGLES'])

NoClusters= x['NoClusters']
numberHorizontal=x['numberHorizontal']
numberVertical=x['numberVertical']
panelOffset=x['panelOffset']
panelSize=x['panelSize']
panelSpacing=x['panelSpacing']
panelGridSize=x['panelGridSize']


print YANGLESjson
# ---------- end python_script_4 ----------
python_script_5 = PythonScript(x=read_file_4)  # -> YSHADINGjson, blindTotalHeight, panelHeight, panelGridSize, blindOffset
# ---------- python_script_5: Python ----------
from ghpythonlib.componentbase import executingcomponent as component
import Grasshopper, GhPython
import System
import Rhino
import rhinoscriptsyntax as rs

class MyComponent(component):
    
    def RunScript(self, x, y):
        #24.03.2022
        #Jasmine de Riedmatten
        #Edited from simulation from ASF
                
        import json
                
        x= json.loads(x) #json.loads(): parse JSON string and convert it to Python Dictionary
                
        print x
                
        # Need to make the distance % of the window size, not absolute value
        YSHADINGjson= json.dumps(x['YSHADING']) #json.dumps(): converts Python object into json string
        blindTotalHeight=x['blindTotalHeight']
        panelHeight=x['panelHeight']
        panelGridSize=x['panelGridSize']
        blindOffset = x['blindOffset']
                
                
        print YSHADINGjson
                
        
        # return outputs if you have them; here I try it for you:
        return YSHADINGjson, blindTotalHeight, panelHeight, panelGridSize, blindOffset
# ---------- end python_script_5 ----------
panel_3 = Panel(python_script_5.panelHeight)
datafolder_for_skymatrix = PythonScript()  # -> data_folder
# ---------- datafolder_for_skymatrix: Python ----------
#Save Temperature from .epw weather file

import sys, os
import datetime

# assign destination:
file_path = ghenv.Component.OnPingDocument().FilePath
asf_folder = '\\'.join(file_path.split('\\')[0:-1])

data_folder = os.path.join(asf_folder, 'data')
print data_folder
# ---------- end datafolder_for_skymatrix ----------
panel_4 = Panel(datafolder_for_skymatrix)
panel_5 = Panel(python_script_4.panelSize)
python_script_6 = PythonScript(x=read_file_3)  # -> out, room_width, room_height, room_depth, BuildingOrientation, glazing_percentage_w, glazing_percentage_h, WindowGridSize
# ---------- python_script_6: Python ----------
import json

x= json.loads(x)

print x


room_width= x['room_width']
room_height=x['room_height']
room_depth=x['room_depth']
BuildingOrientation=x['BuildingOrientation']
glazing_percentage_w=x['glazing_percentage_w']
glazing_percentage_h=x['glazing_percentage_h']
WindowGridSize = x['WindowGridSize']
# ---------- end python_script_6 ----------
boolean_diamond_array = BooleanToggle(True)
edge_tolerance = Slider(0, range=0..1000)
analysisperiod = Ladybug_AnalysisPeriod(
    fromMonth=python_script_3.fromMonth,
    fromDay=python_script_3.fromDay,
    fromHour=python_script_3.fromHour,
    toMonth=python_script_3.toMonth,
    toDay=python_script_3.toDay,
    toHour=python_script_3.toHour)  # -> out, analysisPeriod; plug-in component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
boolean_top_row_short = BooleanToggle(False)
# Render the Building
render_room = PythonScript(
    buildingOrientation=python_script_6.BuildingOrientation,
    room_depth=python_script_6.room_depth,
    room_width=python_script_6.room_width,
    room_height=python_script_6.room_height,
    glazing_percentage_w=python_script_6.glazing_percentage_w,
    glazing_percentage_h=python_script_6.glazing_percentage_h,
    panelHeight=python_script_5.panelHeight)  # -> WallF_W, WallF_PV, AdiabaticSurfaces, WallG; inputs buildingOrientation: Int32
# ---------- render_room: Python ----------
from ghpythonlib.componentbase import executingcomponent as component
import Grasshopper, GhPython
import System
import Rhino
import rhinoscriptsyntax as rs

class MyComponent(component):
    
    def RunScript(self, buildingOrientation, room_depth, room_width, room_height, glazing_percentage_w, glazing_percentage_h, panelHeight):
        #12.10.2015
        #Prageeth Jayathissa
        #Script for rendering the room based on input dimensions
        
        import rhinoscriptsyntax as rs
        
        #Room Dimensions (mm)
        #room_depth=5000
        #room_width=3700
        #room_height=3000 #Check value (approximation)
        #floorThick=200
        #ceilThick=200
        #intWallThick=110 #Real value is 110mm
        #glazeThick=110 #Check this value again
        
        intWallHeight=room_height
        windowHeight=room_height-panelHeight
        
        gpw=glazing_percentage_w
        gph=glazing_percentage_h
        
        
        #Define Global Plane
        planexy=rs.WorldXYPlane()
        planezx=rs.WorldZXPlane()
        planeyz=rs.WorldYZPlane()
        
        print planexy
        #Create rectangle of floor and extrude 200mm
        #base=rs.AddRectangle(plane, room_width+intWallThick*2, room_depth)
        
        planeR=rs.PlaneFromNormal((room_width,0,0),(1,0,0)) #RightWall
        planeB=rs.PlaneFromNormal((0,room_depth,0),(0,1,0)) #BehindWall
        planeC=rs.PlaneFromNormal((0,0,room_height),(0,0,1)) #Ceiling
        planeW =rs.PlaneFromNormal((0,0,panelHeight),(0,1,0)) #Window
        #myBox=rs.ExtrudeCurveStraight(base,(0,0,0),(0,0,room_height))
        
        WallF_W=rs.AddPlaneSurface(planeW,windowHeight,room_width)
        WallF_PV=rs.AddPlaneSurface(planezx,panelHeight,room_width)
        WallL=rs.AddPlaneSurface(planeyz,room_depth,room_height)
        WallR=rs.AddPlaneSurface(planeR,room_depth,room_height)
        WallB=rs.AddPlaneSurface(planeB,room_height,room_width)
        
        #WallF=rs.RotateObject(WallF,[0,0,0],buildingOrientation,axis=(0,0,1))
        
        Floor=rs.AddPlaneSurface(planexy,room_width,room_depth)
        Ceiling=rs.AddPlaneSurface(planeC,room_width,room_depth)
        
        WallG=rs.AddPlaneSurface(planeW,windowHeight*gph,room_width*gpw)
        WallG=rs.MoveObject(WallG,((1-gpw)*room_width/2,0,(1-gph)*windowHeight/2))
        #WallG=rs.RotateObject(WallG,[0,0,0],buildingOrientation,axis=(0,0,1))
        
        #Floor=rs.RotateObject(Floor,[0,0,0],buildingOrientation,axis=(0,0,1))
        #Ceiling=rs.RotateObject(Ceiling,[0,0,0],buildingOrientation,axis=(0,0,1))
        #WallL=rs.RotateObject(WallL,[0,0,0],buildingOrientation,axis=(0,0,1))
        #WallR=rs.RotateObject(WallR,[0,0,0],buildingOrientation,axis=(0,0,1))
        #WallB=rs.RotateObject(WallB,[0,0,0],buildingOrientation,axis=(0,0,1))
        
        AdiabaticSurfaces=[Floor,Ceiling,WallL,WallR,WallB]
        
        # return outputs if you have them; here I try it for you:
        return (WallF_W, WallF_PV, AdiabaticSurfaces, WallG)
# ---------- end render_room ----------
panel_6 = Panel(weatherpath.location_noSuffix)

# ----
# Save details of weather file
number_slider = Slider(1, range=1..31)
importepw = Ladybug_ImportEpw(epwFile=weatherpath.weather_path)  # -> readMe, latitude, location, dryBulbTemperature, dewPointTemperature, relativeHumidity, windSpeed, windDirection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; plug-in component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
analysisperiod_2 = Ladybug_AnalysisPeriod(
    fromMonth=Slider(1, range=1..31),
    fromDay=number_slider,
    fromHour=Slider(1, range=1..24),
    toMonth=Slider(12, range=1..12),
    toDay=Slider(31, range=1..31),
    toHour=Slider(24, range=1..31))  # -> readMe, analysisPeriod; plug-in component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
sunpath = Ladybug_SunPath(
    location=importepw.location,
    hour=12,
    day=21,
    month=12,
    timeStep=1,
    analysisPeriod=analysisperiod_2.analysisPeriod,
    dailyOrAnnualSunPath=True)  # -> readMe, sunVectors, sunAltitudes, sunAzimuths, port, sunSpheresMesh, sunPathCrvs, legend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; plug-in component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
savesunposition = PythonScript(location=panel_6, HOY=sunpath.sunPositionsHOY, Altitude=sunpath.sunAltitudes, Azimuth=sunpath.sunAzimuths)  # -> out, destination; inputs location: list, HOY: list, Altitude: list, Azimuth: list
# ---------- savesunposition: Python ----------
#13.10.2015
#Prageeth Jayathissa
#Python script to read DIVA inputs and produce a CSV file

import sys, os
import datetime

# assign destination:
file_path = ghenv.Component.OnPingDocument().FilePath
current_folder = '\\'.join(file_path.split('\\')[0:-1])
location = str(location)[2:-2]
destination = os.path.join(current_folder + "\data\geographical_location", location)

print destination
print location
if not os.path.isdir(destination):
    os.makedirs(destination)

#Create empty .csv files

with open(os.path.join(destination,'SunPosition.csv'),'w') as f:
    pass
#Write to csv files

#Each itteration will be stored in a row of a csv file
writestring=''
#print HOY
with open(os.path.join(destination,'SunPosition.csv'),'a') as f:
    
    f.write('HOY on line 2, Altitude (degrees from horizontal) on line 3, Azimuth (degrees east of north) on line 4' +'\n')
    
    writestring=''
    for ii in HOY:
        #Create row in csv
        writestring=writestring+str(ii)+','
    #writestring = 'writetest'
    #remove the last comma
    writestring=writestring[:-1]
    print writestring
    #add a new line and write
    f.write(writestring+'\n')
    
    writestring=''
    for ii in Altitude:
        #Create row in csv
        writestring=writestring+str(ii)+','
    #writestring = 'writetest'
    #remove the last comma
    writestring=writestring[:-1]
    print writestring
    #add a new line and write
    f.write(writestring+'\n')
    
    writestring=''    
    for ii in Azimuth:
        #Create row in csv
        writestring=writestring+str(ii)+','
    #writestring = 'writetest'
    #remove the last comma
    writestring=writestring[:-1]
    print writestring
    #add a new line and write
    f.write(writestring+'\n')
    
    f.close()


print "script was executed"
#totalHeat=sum(Heating)
#totalCool=sum(Cool)
#totalLights=sum(Lights)
#totalEquip=sum(Equip)
# ---------- end savesunposition ----------

# ----
# Geometry Calculations
generate_diamond_array = PythonScript(
    edgeTol=edge_tolerance,
    numberHorizontal=python_script_4.numberHorizontal,
    Top_row_short=boolean_top_row_short,
    numberVertical=python_script_4.numberVertical,
    panelOffset=python_script_4.panelOffset,
    panelSize=python_script_4.panelSize,
    panelSpacing=python_script_4.panelSpacing,
    room_width=python_script_6.room_width,
    room_height=python_script_6.room_height,
    diamond_flag=boolean_diamond_array)  # -> outputASFarray, panelSize, panelOffset, diamond_flag
# ---------- generate_diamond_array: Python ----------
from ghpythonlib.componentbase import executingcomponent as component
import Grasshopper, GhPython
import System
import Rhino
import rhinoscriptsyntax as rs

class MyComponent(component):
    
    def RunScript(self, edgeTol, numberHorizontal, Top_row_short, numberVertical, panelOffset, panelSize, panelSpacing, room_width, room_height, diamond_flag):
        #15.12.2015
        #Prageeth Jayathissa
        #Script for calculating the grid layout of the ASF
        #Edited by Jeremias Schmidli
        
        #Description:
            #This script has three parts, out of which only one is executed, depending 
            #on the booleans diamond_flag (diamond- or rectangular-pattern) and 
            #only_odd_rows (if true it automatically determines pattern depending on 
            #room size, if false the number of panels in the first row, the number of 
            #rows and whether the first row is short or long has to be spezified).
        
        #Notes:
            #All coordinates described as "y-value" actually correspond to the "z-value"
            #in Grasshopper.
            #To maximize performance of a simulation, it should be made sure, that this 
            #script is only evaluated once. 
        
        #Staus: Complete
        
        #To Do:
            #Add function to ensure the panel offset is greater than the panel size
        #------------------------------------------------------------------------------
        
        import rhinoscriptsyntax as rs
        import Grasshopper as gh
        import Rhino
        import math
        import json
        
        
        #specify if layout should be generated automatically, depending on room size 
        #(If False, the inputs numberHorizontal, Top_row_short and numberVertical are needed.
        # If True, the input edgeTol is needed.
        # Works only for diamond pattern):
        automatic_layout = False
        
        # calculate diamond pattern if True:
        if diamond_flag == True:
            
            # code from PJ, generates automatic layout:
            if automatic_layout == True:
                
                #Function to determine the location of the first panel
                def first_coordinate():
                    x=room_width/2 -((No_Hpanels-1)*Hspacing)/2 
                    print x
                    y=((No_Vpanels-1)*Vspacing)/2 +(room_height)/2
                    
                    if center_long:
                        if bigstart:
                            x=x
                        else:
                            x+=(Hspacing/2)
                    else:
                        if bigstart:
                            x-=(Hspacing/2)
                            print 'me'
                        else:
                            x=x
                    return (x,y)
                            
                
                #import paramters:
                #room_width=3700.0
                #room_height=3000.00
                
                
                
                #panel size and spacing along the diagonal axis
                #panelSize=400.0
                #panelSpacing=500.0
                #panelThick=2
                #panelOffset=500
                
                #minor adjustments to the panel size
                #edgeTol=1.4
                #V_translation=100
                edgeOverlap=(edgeTol/100)*panelSpacing
                
                
                #transform spacing into vertical and horizontal components
                #Note: sin(45) = 1/math.sqrt(2)
                Hspacing=(panelSpacing/math.sqrt(2))*2
                Vspacing = panelSpacing/math.sqrt(2)
                
                #initialise boolean to determine whether the center pannel line is long
                center_long=True
                #initialise boolean to determine wether the middle row needs to be offset
                center_offset=False 
                
                #find out how many panels fit on the horizontal axis
                #The edgeOverlap allows for more or less panels to fit around the edge
                No_Hpanels=int(math.floor((room_width-panelSize+edgeOverlap)/Hspacing))
                
                #The number of panels on the middle axis is always odd
                #check if the number is even, and if so subtract 1 and define center as a short row
                if not No_Hpanels & 1: #binary logic to determine if the number is even
                    print 'even'
                    No_Hpanels-=1 #subtract by one to make it odd
                    center_long=False #state that the middle row is now the shorter row
                
                
                print 'Hpanels',No_Hpanels
                
                #find out how many panels fit on the vertical axis accounting for an overlap
                No_Vpanels=int(math.floor((room_height-panelSize+edgeOverlap)/Vspacing))
                
                #Number of rows must also be odd for asthetic reasons
                if not No_Vpanels &1:
                    print 'even Vpanels'
                    center_offset=True
                    No_Vpanels-=1  
                    
                print 'V panels' , No_Vpanels
                #Very Messy shit code to determine wether the first row has more panels than the second row
                
                #if (No_Vpanels-1)/2 is odd, then the top row has the same number of panels as the middle
                #if it is even then it has one more or one less depending on whether the center is long or short
                checker=int((No_Vpanels-1)/2)
                print 'checker',checker
                print 'center_long?', center_long
                if center_long:
                    if checker &1: #if checker is odd
                        print '3,7,11 etc Vpanels1'
                        bigstart=False #Top row is shorter than second row
                        oneswitch=-1 #top row has one less panel than middle row
                    else:
                        print '1,5,9 etc Vpanels2'
                        bigstart=True #top row is longer than second row
                        oneswitch=0
                else:
                    if checker &1:
                        print '3,7,11 etc Vpanels3'
                        bigstart=True
                        oneswitch=1 #top panel has one more panel than the middle row
                    else:
                        print '1,5,9 etc Vpanels4'
                        bigstart=False
                        oneswitch=0
                
                #End of messy shitty code
                
                #prints for debugging
                print 'bigstart', bigstart 
                print 'oneswitch',oneswitch
                
                #initialise ASFarray List
                ASFarray=[]
                
                #Produce an empy list nested in a list. The nested list represents each row
                for ii in range(No_Vpanels):
                    ASFarray.append([])
                   
                
                
                #aquire the first coordinate of the top left panel
                (x,y)=first_coordinate()  #see function at the top
                x_first=x #store initial x coordinate
                y_first=y #store initial y coordinate
                
                
                #This next for loop records the coordinate positions of each panel
                #initialise row counter
                icount=0
                for ii in ASFarray:
                    #initialise collumn counter
                    jcount=0
                    
                    for jj in range(No_Hpanels+oneswitch): #first row
                        ii.append((x+jcount*Hspacing,y-icount*Vspacing)) #Append panel coordinate
                        jcount+=1 #next column
                    #Switches so the next row has either one more or one less panel
                    #logic: If the center row is long, then it will switch between its own size
                    #and a size smaller. If not it will switch between its own size and one bigger
                    if center_long:
                        oneswitch-=1
                        oneswitch=(oneswitch%2)*-1 #output either 0 or -1
                    else:
                        oneswitch+=1
                        oneswitch=oneswitch%2 #output is either 0 or 1
                    icount+=1
                    
                    #Determines the starting position of the first panel of the row depending on
                    #if its long or short
                    if icount &1: #if odd
                        if bigstart:
                            x=x_first+(Hspacing/2) #start half a space to the right
                        else:
                            x=x_first -(Hspacing/2) #start half a space to the left
                    else:
                        x=x_first
                    
                    
                
                
                #Write the array output as a json and send to next python file
                #Note: Lists in Lists cannot be sent over grasshopper
                outputASFarray=json.dumps(ASFarray)
                print ASFarray
                
            # Code Jeremias, uses manual specification of number of panels in grid:
            else:
                #make number of rows and columns integers:
                numberHorizontal = int(numberHorizontal)
                numberVertical = int(numberVertical)
                
                #initialise ASFarray List:
                ASFarray=[]
                
                    #Produce an empty list nested in a list. The nested list represents each row
                for ii in range(int(numberVertical)):
                    ASFarray.append([])
                
                
                #store x and y coordinate of first panel in the top row 
                #( & 1 checks if the number is odd):
                    
                #find initial x-coordinate:
                if numberHorizontal & 1 and Top_row_short:
                    x_first=room_width/2-panelSpacing*math.sqrt(2)*(numberHorizontal-1)/2 
                elif numberHorizontal & 1 and not Top_row_short:
                    x_first=room_width/2-panelSpacing*math.sqrt(2)*(numberHorizontal-1)/2 
                elif not numberHorizontal & 1 and Top_row_short:
                    x_first=room_width/2-panelSpacing*math.sqrt(2)*(numberHorizontal)/2
                elif not numberHorizontal & 1 and not Top_row_short:
                    x_first=room_width/2-panelSpacing*math.sqrt(2)*(numberHorizontal-1)/2 
                    
                #find initial y-coordinate:
                if numberVertical & 1:
                    y_first=room_height/2+panelSpacing*(math.sqrt(2)/2)*(numberVertical-1)/2
                else:
                    y_first=room_height/2+panelSpacing*(math.sqrt(2)/2)*(numberVertical-1)/2 
                    
                
                #This next for loop records the coordinate positions of each panel
                
                #initialise x and y coordinate:
                x = x_first
                y = y_first
                
                #initialise row counter
                icount=0
                for ii in ASFarray:
                    #initialise collumn counter
                    jcount=0
                    
                    if (numberHorizontal & 1) and (icount & 1) and Top_row_short:
                        
                        for jj in range(int(numberHorizontal)+1): #first row
                            ii.append((x-panelSpacing*math.sqrt(2)/2+jcount*panelSpacing*math.sqrt(2),y-icount*panelSpacing*math.sqrt(2)/2)) #Append panel coordinate
                            jcount+=1 #next column
                            
                    elif (numberHorizontal & 1) and not (icount & 1) and Top_row_short:
                        
                        for jj in range(int(numberHorizontal)): #first row
                            ii.append((x+jcount*panelSpacing*math.sqrt(2),y-icount*panelSpacing*math.sqrt(2)/2)) #Append panel coordinate
                            jcount+=1 #next column
                            
                    elif (numberHorizontal & 1) and (icount & 1) and not Top_row_short:
                        
                        for jj in range(int(numberHorizontal)-1): #first row
                            ii.append((x+panelSpacing*math.sqrt(2)/2+jcount*panelSpacing*math.sqrt(2),y-icount*panelSpacing*math.sqrt(2)/2)) #Append panel coordinate
                            jcount+=1 #next column
                            
                    elif (numberHorizontal & 1) and not (icount & 1) and not Top_row_short:
                        
                        for jj in range(int(numberHorizontal)): #first row
                            ii.append((x+jcount*panelSpacing*math.sqrt(2),y-icount*panelSpacing*math.sqrt(2)/2)) #Append panel coordinate
                            jcount+=1 #next column
                            
                    elif not (numberHorizontal & 1) and (icount & 1) and Top_row_short:
                        
                        for jj in range(int(numberHorizontal)+1): #first row
                            ii.append((x+jcount*panelSpacing*math.sqrt(2),y-icount*panelSpacing*math.sqrt(2)/2)) #Append panel coordinate
                            jcount+=1 #next column
                    
                    elif not (numberHorizontal & 1) and not (icount & 1) and Top_row_short:
                        
                        for jj in range(int(numberHorizontal)): #first row
                            ii.append((x+panelSpacing*math.sqrt(2)/2+jcount*panelSpacing*math.sqrt(2),y-icount*panelSpacing*math.sqrt(2)/2)) #Append panel coordinate
                            jcount+=1 #next column
                    elif not (numberHorizontal & 1) and (icount & 1) and not Top_row_short:
                        
                        for jj in range(int(numberHorizontal)-1): #first row
                            ii.append((x+panelSpacing*math.sqrt(2)/2+jcount*panelSpacing*math.sqrt(2),y-icount*panelSpacing*math.sqrt(2)/2)) #Append panel coordinate
                            jcount+=1 #next column
                    
                    elif not (numberHorizontal & 1) and not (icount & 1) and not Top_row_short:
                        
                        for jj in range(int(numberHorizontal)): #first row
                            ii.append((x+jcount*panelSpacing*math.sqrt(2),y-icount*panelSpacing*math.sqrt(2)/2)) #Append panel coordinate
                            jcount+=1 #next columnelse :
                   
                    #next row
                    icount+=1
                    
                    
                #Write the array output as a json and send to next python file
                #Note: Lists in Lists cannot be sent over grasshopper
                outputASFarray=json.dumps(ASFarray)
                print ASFarray
            
        # calculate rectangular pattern:
        else:
            
            #make number of rows and columns integers:
            numberHorizontal = int(numberHorizontal)
            numberVertical = int(numberVertical)
            
            #initialise ASFarray List:
            ASFarray=[]
            
                #Produce an empy list nested in a list. The nested list represents each row
            for ii in range(int(numberVertical)):
                ASFarray.append([])
            
            
            #store initial x and y coordinate:
            if numberHorizontal & 1:
                x_first=room_width/2-panelSpacing*(numberHorizontal-1)/2 
            else:
                x_first=room_width/2-panelSpacing*(numberHorizontal-2)/2 - panelSpacing/2 
            if numberVertical & 1:
                y_first=room_height/2+panelSpacing*(numberVertical-1)/2
            else:
                y_first=room_height/2+panelSpacing*(numberVertical-2)/2 + panelSpacing/2
                
            
            #This next for loop records the coordinate positions of each panel
            
            #initialise x and y coordinate:
            x = x_first
            y = y_first
            
            #initialise row counter
            icount=0
            for ii in ASFarray:
                #initialise collumn counter
                jcount=0
                
                for jj in range(int(numberHorizontal)): #first row
                    ii.append((x+jcount*panelSpacing,y-icount*panelSpacing)) #Append panel coordinate
                    jcount+=1 #next column
                
                #next row
                icount+=1
                
                
            #Write the array output as a json and send to next python file
            #Note: Lists in Lists cannot be sent over grasshopper
            outputASFarray=json.dumps(ASFarray)
            print ASFarray
        
        # return outputs if you have them; here I try it for you:
        return (outputASFarray, panelSize, panelOffset, diamond_flag)
# ---------- end generate_diamond_array ----------
save_parameters = PythonScript(
    XANGLES=python_script_4.XANGLESjson,
    YANGLES=python_script_4.YANGLESjson,
    NoClusters=python_script_4.NoClusters,
    desiredGridPointSize=python_script_4.panelGridSize,
    numberHorizontal=python_script_4.numberHorizontal,
    numberVertical=python_script_4.numberVertical,
    panelSize=python_script_4.panelSize,
    panelSpacing=python_script_4.panelSpacing,
    panelOffset=python_script_4.panelOffset,
    outputASFarray=generate_diamond_array.outputASFarray,
    buildingOrientation=python_script_6.BuildingOrientation,
    room_width=python_script_6.room_width,
    room_height=python_script_6.room_height,
    room_depth=python_script_6.room_depth,
    gpW=python_script_6.glazing_percentage_w,
    gpH=python_script_6.glazing_percentage_h,
    WindowGridSize=python_script_6.WindowGridSize,
    DataName=python_script.DataName)  # -> a
# ---------- save_parameters: Python ----------
from ghpythonlib.componentbase import executingcomponent as component
import Grasshopper, GhPython
import System
import Rhino
import rhinoscriptsyntax as rs

class MyComponent(component):
    
    def RunScript(self, XANGLES, YANGLES, NoClusters, desiredGridPointSize, numberHorizontal, numberVertical, panelSize, panelSpacing, panelOffset, outputASFarray, buildingOrientation, room_width, room_height, room_depth, gpW, gpH, WindowGridSize, DataName):
        #06.01.2016
        #Jeremias Schmidli
        #Python script to produce a python file with ASF layout and combination parameters for post processing
        
        import sys, os
        import json
        
        # assign destination:
        file_path = ghenv.Component.OnPingDocument().FilePath
        current_folder = '\\'.join(file_path.split('\\')[0:-1])
        destination =  DataName
        
        destination_path = os.path.join(os.path.join(current_folder, 'RadiationData'), 'radiation_results_' + DataName)
        print destination_path
        print destination
        #unpack json file and coppy ASF array to create an empty anglearray
        ASFarray=json.loads(outputASFarray)
        
        #Create empty .csv file and add information on parameters
        
        with open(os.path.join(destination_path,'LayoutAndCombinations.txt'),'w') as f:
            f.write('XANGLES = ' + XANGLES+'\n')
            f.write('YANGLES = ' + YANGLES+'\n')
            f.write('NoClusters = ' + str(NoClusters) +'\n')
            f.write('panelSize = ' + str(panelSize) +'\n')
            f.write('panelSpacing = ' + str(panelSpacing) + '\n')
            f.write('NumPanHor = ' + str(numberHorizontal) +'\n')
            f.write('NumPanVer = ' + str(numberVertical) +'\n')
            f.write('panelOffset = ' + str(panelOffset) + '\n')
            f.write('room_width = ' + str(room_width) + '\n')
            f.write('room_height = ' + str(room_height) +'\n')
            f.write('room_depth = ' + str(room_depth) +'\n')
            f.write('glazingPercWidth = ' + str(gpW) + '\n')
            f.write('glazingPercHeight = ' + str(gpH) + '\n')
            f.write('WindowGridSize = ' + str(WindowGridSize) + '\n')
            f.write('desiredGridPointSize = ' + str(desiredGridPointSize) + '\n')
            f.write('buildingOrientation = ' + str(buildingOrientation) + '\n')
            f.write('ASFarray = ' + str(ASFarray))
            f.close()
        
        # return outputs if you have them; here I try it for you:
        return a
# ---------- end save_parameters ----------
generate_diamond_array_2 = PythonScript(panelHeight=python_script_5.panelHeight, room_width=python_script_6.room_width, room_height=python_script_6.room_height)  # -> outputASFarray, panelSize, panelOffset, diamond_flag
# ---------- generate_diamond_array_2: Python ----------
from ghpythonlib.componentbase import executingcomponent as component
import Grasshopper, GhPython
import System
import Rhino
import rhinoscriptsyntax as rs

class MyComponent(component):
    
    def RunScript(self, panelOffset, panelHeight, room_width, room_height):
        #24.03.2022
        #Edited by Jasmine de Riedmatten
        
        #Description:
            #This script create teh geometry of the Classical facade 
            #consisting of movable blinds and PV surface underneath
            #
        
        #Notes:
            #All coordinates described as "y-value" actually correspond to the "z-value"
            #in Grasshopper.
            #To maximize performance of a simulation, it should be made sure, that this 
            #script is only evaluated once. 
        
        #------------------------------------------------------------------------------
        
        import rhinoscriptsyntax as rs
        import Grasshopper as gh
        import Rhino
        import math
        import json
        
        
        #layout is generated automatically, depending on room size 
        automatic_layout = True
        
        
        #Function to determine the location of the panel
        def panel_coordinate():
            x=room_width/2 -((No_Hpanels-1)*Hspacing)/2 
            print x
            y=((No_Vpanels-1)*Vspacing)/2 +(room_height)/2
            
            if center_long:
                if bigstart:
                    x=x
                else:
                    x+=(Hspacing/2)
            else:
                if bigstart:
                    x-=(Hspacing/2)
                    print 'me'
                else:
                    x=x
            return (x,y)
                            
                
                #import paramters:
                #room_width=3700.0
                #room_height=3000.00
                
                
                
                #panel size and spacing along the diagonal axis
                #panelSize=400.0
                #panelSpacing=500.0
                #panelThick=2
                #panelOffset=500
                
                #minor adjustments to the panel size
                #edgeTol=1.4
                #V_translation=100
                edgeOverlap=(edgeTol/100)*panelSpacing
                
                
                #transform spacing into vertical and horizontal components
                #Note: sin(45) = 1/math.sqrt(2)
                Hspacing=(panelSpacing/math.sqrt(2))*2
                Vspacing = panelSpacing/math.sqrt(2)
                
                #initialise boolean to determine whether the center pannel line is long
                center_long=True
                #initialise boolean to determine wether the middle row needs to be offset
                center_offset=False 
                
                #find out how many panels fit on the horizontal axis
                #The edgeOverlap allows for more or less panels to fit around the edge
                No_Hpanels=int(math.floor((room_width-panelSize+edgeOverlap)/Hspacing))
                
                #The number of panels on the middle axis is always odd
                #check if the number is even, and if so subtract 1 and define center as a short row
                if not No_Hpanels & 1: #binary logic to determine if the number is even
                    print 'even'
                    No_Hpanels-=1 #subtract by one to make it odd
                    center_long=False #state that the middle row is now the shorter row
                
                
                print 'Hpanels',No_Hpanels
                
                #find out how many panels fit on the vertical axis accounting for an overlap
                No_Vpanels=int(math.floor((room_height-panelSize+edgeOverlap)/Vspacing))
                
                #Number of rows must also be odd for asthetic reasons
                if not No_Vpanels &1:
                    print 'even Vpanels'
                    center_offset=True
                    No_Vpanels-=1  
                    
                print 'V panels' , No_Vpanels
                #Very Messy shit code to determine wether the first row has more panels than the second row
                
                #if (No_Vpanels-1)/2 is odd, then the top row has the same number of panels as the middle
                #if it is even then it has one more or one less depending on whether the center is long or short
                checker=int((No_Vpanels-1)/2)
                print 'checker',checker
                print 'center_long?', center_long
                if center_long:
                    if checker &1: #if checker is odd
                        print '3,7,11 etc Vpanels1'
                        bigstart=False #Top row is shorter than second row
                        oneswitch=-1 #top row has one less panel than middle row
                    else:
                        print '1,5,9 etc Vpanels2'
                        bigstart=True #top row is longer than second row
                        oneswitch=0
                else:
                    if checker &1:
                        print '3,7,11 etc Vpanels3'
                        bigstart=True
                        oneswitch=1 #top panel has one more panel than the middle row
                    else:
                        print '1,5,9 etc Vpanels4'
                        bigstart=False
                        oneswitch=0
                
                #End of messy shitty code
                
                #prints for debugging
                print 'bigstart', bigstart 
                print 'oneswitch',oneswitch
                
                #initialise ASFarray List
                ASFarray=[]
                
                #Produce an empy list nested in a list. The nested list represents each row
                for ii in range(No_Vpanels):
                    ASFarray.append([])
                   
                
                
                #aquire the first coordinate of the top left panel
                (x,y)=first_coordinate()  #see function at the top
                x_first=x #store initial x coordinate
                y_first=y #store initial y coordinate
                
                
                #This next for loop records the coordinate positions of each panel
                #initialise row counter
                icount=0
                for ii in ASFarray:
                    #initialise collumn counter
                    jcount=0
                    
                    for jj in range(No_Hpanels+oneswitch): #first row
                        ii.append((x+jcount*Hspacing,y-icount*Vspacing)) #Append panel coordinate
                        jcount+=1 #next column
                    #Switches so the next row has either one more or one less panel
                    #logic: If the center row is long, then it will switch between its own size
                    #and a size smaller. If not it will switch between its own size and one bigger
                    if center_long:
                        oneswitch-=1
                        oneswitch=(oneswitch%2)*-1 #output either 0 or -1
                    else:
                        oneswitch+=1
                        oneswitch=oneswitch%2 #output is either 0 or 1
                    icount+=1
                    
                    #Determines the starting position of the first panel of the row depending on
                    #if its long or short
                    if icount &1: #if odd
                        if bigstart:
                            x=x_first+(Hspacing/2) #start half a space to the right
                        else:
                            x=x_first -(Hspacing/2) #start half a space to the left
                    else:
                        x=x_first
                    
                    
                
                
                #Write the array output as a json and send to next python file
                #Note: Lists in Lists cannot be sent over grasshopper
                outputASFarray=json.dumps(ASFarray)
                print ASFarray
                
            # Code Jeremias, uses manual specification of number of panels in grid:
            else:
                #make number of rows and columns integers:
                numberHorizontal = int(numberHorizontal)
                numberVertical = int(numberVertical)
                
                #initialise ASFarray List:
                ASFarray=[]
                
                    #Produce an empty list nested in a list. The nested list represents each row
                for ii in range(int(numberVertical)):
                    ASFarray.append([])
                
                
                #store x and y coordinate of first panel in the top row 
                #( & 1 checks if the number is odd):
                    
                #find initial x-coordinate:
                if numberHorizontal & 1 and Top_row_short:
                    x_first=room_width/2-panelSpacing*math.sqrt(2)*(numberHorizontal-1)/2 
                elif numberHorizontal & 1 and not Top_row_short:
                    x_first=room_width/2-panelSpacing*math.sqrt(2)*(numberHorizontal-1)/2 
                elif not numberHorizontal & 1 and Top_row_short:
                    x_first=room_width/2-panelSpacing*math.sqrt(2)*(numberHorizontal)/2
                elif not numberHorizontal & 1 and not Top_row_short:
                    x_first=room_width/2-panelSpacing*math.sqrt(2)*(numberHorizontal-1)/2 
                    
                #find initial y-coordinate:
                if numberVertical & 1:
                    y_first=room_height/2+panelSpacing*(math.sqrt(2)/2)*(numberVertical-1)/2
                else:
                    y_first=room_height/2+panelSpacing*(math.sqrt(2)/2)*(numberVertical-1)/2 
                    
                
                #This next for loop records the coordinate positions of each panel
                
                #initialise x and y coordinate:
                x = x_first
                y = y_first
                
                #initialise row counter
                icount=0
                for ii in ASFarray:
                    #initialise collumn counter
                    jcount=0
                    
                    if (numberHorizontal & 1) and (icount & 1) and Top_row_short:
                        
                        for jj in range(int(numberHorizontal)+1): #first row
                            ii.append((x-panelSpacing*math.sqrt(2)/2+jcount*panelSpacing*math.sqrt(2),y-icount*panelSpacing*math.sqrt(2)/2)) #Append panel coordinate
                            jcount+=1 #next column
                            
                    elif (numberHorizontal & 1) and not (icount & 1) and Top_row_short:
                        
                        for jj in range(int(numberHorizontal)): #first row
                            ii.append((x+jcount*panelSpacing*math.sqrt(2),y-icount*panelSpacing*math.sqrt(2)/2)) #Append panel coordinate
                            jcount+=1 #next column
                            
                    elif (numberHorizontal & 1) and (icount & 1) and not Top_row_short:
                        
                        for jj in range(int(numberHorizontal)-1): #first row
                            ii.append((x+panelSpacing*math.sqrt(2)/2+jcount*panelSpacing*math.sqrt(2),y-icount*panelSpacing*math.sqrt(2)/2)) #Append panel coordinate
                            jcount+=1 #next column
                            
                    elif (numberHorizontal & 1) and not (icount & 1) and not Top_row_short:
                        
                        for jj in range(int(numberHorizontal)): #first row
                            ii.append((x+jcount*panelSpacing*math.sqrt(2),y-icount*panelSpacing*math.sqrt(2)/2)) #Append panel coordinate
                            jcount+=1 #next column
                            
                    elif not (numberHorizontal & 1) and (icount & 1) and Top_row_short:
                        
                        for jj in range(int(numberHorizontal)+1): #first row
                            ii.append((x+jcount*panelSpacing*math.sqrt(2),y-icount*panelSpacing*math.sqrt(2)/2)) #Append panel coordinate
                            jcount+=1 #next column
                    
                    elif not (numberHorizontal & 1) and not (icount & 1) and Top_row_short:
                        
                        for jj in range(int(numberHorizontal)): #first row
                            ii.append((x+panelSpacing*math.sqrt(2)/2+jcount*panelSpacing*math.sqrt(2),y-icount*panelSpacing*math.sqrt(2)/2)) #Append panel coordinate
                            jcount+=1 #next column
                    elif not (numberHorizontal & 1) and (icount & 1) and not Top_row_short:
                        
                        for jj in range(int(numberHorizontal)-1): #first row
                            ii.append((x+panelSpacing*math.sqrt(2)/2+jcount*panelSpacing*math.sqrt(2),y-icount*panelSpacing*math.sqrt(2)/2)) #Append panel coordinate
                            jcount+=1 #next column
                    
                    elif not (numberHorizontal & 1) and not (icount & 1) and not Top_row_short:
                        
                        for jj in range(int(numberHorizontal)): #first row
                            ii.append((x+jcount*panelSpacing*math.sqrt(2),y-icount*panelSpacing*math.sqrt(2)/2)) #Append panel coordinate
                            jcount+=1 #next columnelse :
                   
                    #next row
                    icount+=1
                    
                    
                #Write the array output as a json and send to next python file
                #Note: Lists in Lists cannot be sent over grasshopper
                outputASFarray=json.dumps(ASFarray)
                print ASFarray
            
        # calculate rectangular pattern:
        else:
            
            #make number of rows and columns integers:
            numberHorizontal = int(numberHorizontal)
            numberVertical = int(numberVertical)
            
            #initialise ASFarray List:
            ASFarray=[]
            
                #Produce an empy list nested in a list. The nested list represents each row
            for ii in range(int(numberVertical)):
                ASFarray.append([])
            
            
            #store initial x and y coordinate:
            if numberHorizontal & 1:
                x_first=room_width/2-panelSpacing*(numberHorizontal-1)/2 
            else:
                x_first=room_width/2-panelSpacing*(numberHorizontal-2)/2 - panelSpacing/2 
            if numberVertical & 1:
                y_first=room_height/2+panelSpacing*(numberVertical-1)/2
            else:
                y_first=room_height/2+panelSpacing*(numberVertical-2)/2 + panelSpacing/2
                
            
            #This next for loop records the coordinate positions of each panel
            
            #initialise x and y coordinate:
            x = x_first
            y = y_first
            
            #initialise row counter
            icount=0
            for ii in ASFarray:
                #initialise collumn counter
                jcount=0
                
                for jj in range(int(numberHorizontal)): #first row
                    ii.append((x+jcount*panelSpacing,y-icount*panelSpacing)) #Append panel coordinate
                    jcount+=1 #next column
                
                #next row
                icount+=1
                
                
            #Write the array output as a json and send to next python file
            #Note: Lists in Lists cannot be sent over grasshopper
            outputASFarray=json.dumps(ASFarray)
            print ASFarray
        
        # return outputs if you have them; here I try it for you:
        return (outputASFarray, panelSize, panelOffset, diamond_flag)
# ---------- end generate_diamond_array_2 ----------
save_parameters_2 = PythonScript(
    YSHADING=python_script_5.YSHADINGjson,
    blindSpacing=python_script_5.blindTotalHeight,
    desiredGridPointSize=python_script_5.panelGridSize,
    panelHeight=python_script_5.panelHeight,
    outputASFarray=generate_diamond_array.outputASFarray,
    buildingOrientation=python_script_6.BuildingOrientation,
    room_width=python_script_6.room_width,
    room_height=python_script_6.room_height,
    room_depth=python_script_6.room_depth,
    gpW=python_script_6.glazing_percentage_w,
    gpH=python_script_6.glazing_percentage_h,
    WindowGridSize=python_script_6.WindowGridSize,
    DataName=python_script.DataName)  # -> a
# ---------- save_parameters_2: Python ----------
#06.01.2016
#Jeremias Schmidli
#Python script to produce a python file with ASF layout and combination parameters for post processing
#24.03.2022
#Modified by Jasmine de Riedmatten
        
import sys, os
import json
        
# assign destination:
file_path = ghenv.Component.OnPingDocument().FilePath
current_folder = '\\'.join(file_path.split('\\')[0:-1])
destination =  DataName
        
destination_path = os.path.join(os.path.join(current_folder, 'RadiationData'), 'radiation_results_' + DataName)
print destination_path
print destination
#unpack json file and coppy ASF array to create an empty anglearray
#ASFarray=json.loads(outputASFarray)
        
#Create empty .csv file and add information on parameters
        
with open(os.path.join(destination_path,'LayoutAndCombinations.txt'),'w') as f:
    f.write('YSHADING = ' + YSHADING+'\n')
    f.write('blindSpacing = ' + str(blindSpacing) + '\n')
    f.write('panelOffset = ' + str(panelOffset) + '\n')
    f.write('panelHeight = ' + str(panelHeight) +'\n')
    f.write('room_width = ' + str(room_width) + '\n')
    f.write('room_height = ' + str(room_height) +'\n')
    f.write('room_depth = ' + str(room_depth) +'\n')
    f.write('glazingPercWidth = ' + str(gpW) + '\n')
    f.write('glazingPercHeight = ' + str(gpH) + '\n')
    f.write('WindowGridSize = ' + str(WindowGridSize) + '\n')
    f.write('desiredGridPointSize = ' + str(desiredGridPointSize) + '\n')
    f.write('buildingOrientation = ' + str(buildingOrientation) + '\n')
    #f.write('ASFarray = ' + str(ASFarray))
    f.close()
# ---------- end save_parameters_2 ----------
panel_7 = Panel(analysisperiod.analysisPeriod)
render_room_2 = PythonScript(
    buildingOrientation=python_script_6.BuildingOrientation,
    WallF_W=render_room.WallF_W,
    WallF_PV=render_room.WallF_PV,
    AdiabaticSurfaces=render_room.AdiabaticSurfaces,
    WallG=render_room.WallG)  # -> WallF_W, WallF_PV, AdiabaticSurfaces, WallG; inputs AdiabaticSurfaces: list
# ---------- render_room_2: Python ----------
from ghpythonlib.componentbase import executingcomponent as component
import Grasshopper, GhPython
import System
import Rhino
import rhinoscriptsyntax as rs

class MyComponent(component):
    
    def RunScript(self, buildingOrientation, WallF_W, WallF_PV, AdiabaticSurfaces, WallG):
        #03.05.2016
        #Jeremias
        #Script to change orientation of building
        
        import rhinoscriptsyntax as rs
        
        
        
        #Define Global Plane
        planexy=rs.WorldXYPlane()
        planezx=rs.WorldZXPlane()
        planeyz=rs.WorldYZPlane()
        
        
        WallG=rs.RotateObject(WallG,[0,0,0],buildingOrientation,axis=(0,0,1))
        
        WallF_W=rs.RotateObject(WallF_W,[0,0,0],buildingOrientation,axis=(0,0,1))
        WallF_PV=rs.RotateObject(WallF_PV,[0,0,0],buildingOrientation,axis=(0,0,1))
        
        print len(AdiabaticSurfaces)
        print AdiabaticSurfaces
        AdSurf = []
        for i in range(len(AdiabaticSurfaces)):
            AdSurf.append(rs.RotateObject(AdiabaticSurfaces[i],[0,0,0],buildingOrientation,axis=(0,0,1)))
        
        
        # return outputs if you have them; here I try it for you:
        return (WallF_W, WallF_PV, AdiabaticSurfaces, WallG)
# ---------- end render_room_2 ----------
multiplication = Multiplication(A=python_script_6.BuildingOrientation, _1=-1)
render_diamond_array = PythonScript(
    buildingOrientation=python_script_6.BuildingOrientation,
    outputASFarray=generate_diamond_array_2.outputASFarray,
    panelSize=generate_diamond_array_2.panelSize,
    panelOffset=generate_diamond_array_2.panelOffset,
    diamond_flag=generate_diamond_array_2.diamond_flag)  # -> DIVA_temprender, LB_temprender; inputs buildingOrientation: Int32
# ---------- render_diamond_array: Python ----------
from ghpythonlib.componentbase import executingcomponent as component
import Grasshopper, GhPython
import System
import Rhino
import rhinoscriptsyntax as rs

class MyComponent(component):
    
    def RunScript(self, buildingOrientation, YSHADINGS, room_width, room_height, panelHeight, panelOffset):
        #13.10.2015
        #Prageeth Jayathissa
        #Python script to render the ASF based on room given array and angles
        
        #Status: Completed with issues
        
        #Issues: When rotating panels, the rotation around the Y axis doesn't rotate
        #around the global Y axis, but the new Y axis based off the previous X axis roation
        #------------------------------------------------
        
        import json
        import rhinoscriptsyntax as rs
        import copy
        import math
        
        #diamond_flag = False
        #Load JSON file
        #ASFarray=json.loads(outputASFarray)
        #ASFangles=json.loads(outputASFangles)
        
        
        #define Plane where Facade will be built
        plane=rs.WorldZXPlane()
        
        #temprender is used for temproarily rendering the ASF. DIVA is rotated, LB not
        DIVA_temprender=[]
        LB_temprender=[]
        
        #duplicate the ASFarray wihout linking it togher
        #Note: ASFrectangles=ASFarray doesn't work as they will both be edited
        #ASFrectangles=copy.deepcopy(ASFarray)
        
        blind_covering_heigth=YSHADING*room_width
        print blind_covering_heigth
        
        
        #if diamond_flag:
            
            #initialise row counter
            #icount=0
            for ii in ASFarray:
                #initialise column counter
                jcount=0
                for jj in ii:
                    #Draw rectangles on the ZX plane
                    LB_panel=rs.AddRectangle(plane, panelSize, panelSize)
                    DIVA_panel=rs.AddRectangle(plane, panelSize, panelSize)
                    
                    #Move them so that the middle is in the origin
                    LB_panel=rs.MoveObject(LB_panel,(-panelSize/2,0,-panelSize/2))
                    DIVA_panel=rs.MoveObject(DIVA_panel,(-panelSize/2,0,-panelSize/2))
                    
                    #rotate it to make the diamond shape
                    LB_panel=rs.RotateObject(LB_panel,[0,0,0],45,axis=(0,1,0))
                    DIVA_panel=rs.RotateObject(DIVA_panel,[0,0,0],45,axis=(0,1,0))
                    
                    #Extrude it and cap the holes
                    #DIVA_panel=rs.ExtrudeCurveStraight(DIVA_panel,(0,0,0),(0,-panelThick,0))
                    #rs.CapPlanarHoles(DIVA_panel)
                    
                    #tilt the panels
                    LB_panel=rs.RotateObject(LB_panel,[0,0,0],-ASFangles[icount][jcount][0],axis=(1,0,0))
                    DIVA_panel=rs.RotateObject(DIVA_panel,[0,0,0],-ASFangles[icount][jcount][0],axis=(1,0,0))
                    
                    #rotate axis of panels:
                    z_new = (0, -math.sin(math.pi/180*(-ASFangles[icount][jcount][0])) , math.cos(math.pi/180*(-ASFangles[icount][jcount][0])))
                    
                    #rotate panels azimuth
                    LB_panel=rs.RotateObject(LB_panel,[0,0,0],ASFangles[icount][jcount][1],axis=z_new)
                    DIVA_panel=rs.RotateObject(DIVA_panel,[0,0,0],ASFangles[icount][jcount][1],axis=z_new)
                    
                    #move panels
                    LB_panel=rs.MoveObject(LB_panel,(jj[0],-panelOffset,jj[1]))
                    DIVA_panel=rs.MoveObject(DIVA_panel,(jj[0],-panelOffset,jj[1]))
                    
                    #render LB panels
                    LB_temprender.append(LB_panel)
                    
                    #rotate panels for DIVA by the building Orientation (this happens directly in LB, later)
                    DIVA_panel=rs.RotateObject(DIVA_panel,[0,0,0],buildingOrientation,axis=(0,0,1))
                    
                    #render DIVA panels
                    DIVA_temprender.append(DIVA_panel)
                    
                    #This is the true output which will be used for further analysis
                    #ASFrectangles[icount][jcount]=DIVA_panel
        
                    jcount+=1
                icount+=1
                
        else:
            #initialise row counter
            icount=0
            for ii in ASFarray:
                #initialise column counter
                jcount=0
                for jj in ii:
                    #Draw rectange on the ZX plane
                    
                    DIVA_panel=rs.AddRectangle(plane, panelSize, panelSize)
                    DIVA_panel=rs.MoveObject(DIVA_panel,(-panelSize/2,0,-panelSize/2))
                    #rotate it to make the diamond shape
                    #DIVA_panel=rs.RotateObject(DIVA_panel,[0,0,0],45,axis=(0,1,0))
                    #Extrude it and cap the holes
                    #DIVA_panel=rs.ExtrudeCurveStraight(DIVA_panel,(0,0,0),(0,-panelThick,0))
                    #rs.CapPlanarHoles(DIVA_panel)
                    #tilt the panels
                    DIVA_panel=rs.RotateObject(DIVA_panel,[0,0,0],-ASFangles[icount][jcount][0],axis=(1,0,0))
                    z_new = (0, -math.sin(math.pi/180*(-ASFangles[icount][jcount][0])) , math.cos(math.pi/180*(-ASFangles[icount][jcount][0])))
                    print z_new
                    DIVA_panel=rs.RotateObject(DIVA_panel,[0,0,0],ASFangles[icount][jcount][1],axis=z_new)
                    DIVA_panel=rs.MoveObject(DIVA_panel,(jj[0],-panelOffset,jj[1]))
                    LB_panel=copy.deepcopy(DIVA_panel)
                    DIVA_panel=rs.RotateObject(DIVA_panel,[0,0,0],buildingOrientation,axis=(0,0,1))
                    
                    
                    DIVA_temprender.append(DIVA_panel)
                    LB_temprender.append(LB_panel)
                    #This is the true output which will be used for further analysis
                    ASFrectangles[icount][jcount]=DIVA_panel
            
                    jcount+=1
                icount+=1
        
        
        # return outputs if you have them; here I try it for you:
        return (DIVA_temprender, LB_temprender)
# ---------- end render_diamond_array ----------
# Render the ASF
combinationmaker_simple = PythonScript(outputASFarray=generate_diamond_array.outputASFarray, x_angle=python_script_2.x_angle, y_angle=python_script_2.y_angle)  # -> out, outputASFangles; disabled
# ---------- combinationmaker_simple: Python ----------
#Import Modules------------------------------------------------

import json
import math
import copy
####---CHAPTER1-------------------------

#unpack json file and coppy ASF array to create an empty anglearray
ASFarray=json.loads(outputASFarray)
ASFangles=copy.deepcopy(ASFarray)


for icount,ii in enumerate(ASFangles):
    for jcount, ii in enumerate(ii):
        ASFangles[icount][jcount]=(x_angle,y_angle)
        
        
outputASFangles=json.dumps(ASFangles)
# ---------- end combinationmaker_simple ----------
horizon = PythonScript()  # -> ContextSurface
# ---------- horizon: Python ----------
#12.10.2015
#Prageeth Jayathissa
#Script for rendering the room based on input dimensions

import rhinoscriptsyntax as rs


room_width=200000
room_height=200000 #Check value (approximation)

intWallHeight=room_height



#Define Global Plane
planexy=rs.WorldXYPlane()
planezx=rs.WorldZXPlane()
planeyz=rs.WorldYZPlane()





WallF=rs.AddPlaneSurface(planexy,room_height,room_width)
WallF = rs.MoveObject(WallF,[-100000,-190000,-6000])


ContextSurface = WallF
# ---------- end horizon ----------
cont_surf = PythonScript()  # -> ContextSurface
# ---------- cont_surf: Python ----------
#12.10.2015
#Prageeth Jayathissa
#Script for rendering the room based on input dimensions

import rhinoscriptsyntax as rs


room_width=37000
room_height=30000 #Check value (approximation)

intWallHeight=room_height



#Define Global Plane
planexy=rs.WorldXYPlane()
planezx=rs.WorldZXPlane()
planeyz=rs.WorldYZPlane()





WallF=rs.AddPlaneSurface(planezx,room_height,room_width)
WallF = rs.MoveObject(WallF,[-16000,1,-10000])


ContextSurface = WallF
# ---------- end cont_surf ----------

# ----
# Ladybug Solar Analysis
# Create Mesh for Radiation Analysis
# Calculate Radiation on Panels
# Run Ladybug
# Set Legend of Radiation Results
# Create Sky Matrix
# Sky Dome for reference
ladybug = Ladybug_Ladybug()  # -> Vviiiiiiiiiizzz; plug-in component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
panel_8 = Panel(ladybug)
gencumulativeskymtx = Ladybug_GenCumulativeSkyMtx(
    epwFile=weatherpath.weather_path,
    skyDensity=0,
    workingDir=datafolder_for_skymatrix,
    useOldRes=Toggle(False),
    runIt=Toggle(True))  # -> readMe, cumulativeSkyMtx; plug-in component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
mesh_number = PythonScript(
    panelHeight=python_script_5.panelHeight,
    room_width=python_script_6.room_width,
    desiredGridPointSize=python_script_5.panelGridSize)  # -> meshNumber_ver, meshNumber_hor
# ---------- mesh_number: Python ----------
from ghpythonlib.componentbase import executingcomponent as component
import Grasshopper, GhPython
import System
import Rhino
import rhinoscriptsyntax as rs

class MyComponent(component):
    
    def RunScript(self, panelHeight, room_width, desiredGridPointSize):
        """ 
        Script to calculate the number of points into which the mesh of the panel should
        be devided, in order to create approximately the desired meshPoint Size
        
        author: Jeremias
        edit: Jasmine
        """
        
        meshNumber_ver = int(round(panelHeight/float(desiredGridPointSize)))
        meshNumber_hor = int(round(room_width/float(desiredGridPointSize)))
        print "mesh number vertically equals: " + str(meshNumber_ver)
        print "mesh number horizontally equals: " + str(meshNumber_hor)
        
        if not (meshNumber_ver)*desiredGridPointSize == panelHeight:
            
            print "warning: Vertically, desiredGridPointSize is not equal to the resulting grid point" \
                + " size. The grid point size will be: "  + str(panelHeight/float(meshNumber_ver))
        if not (meshNumber_hor)*desiredGridPointSize == panelHeight:
            
            print "warning: Horizontally, desiredGridPointSize is not equal to the resulting grid point" \
                + " size. The grid point size will be: "  + str(room_width/float(meshNumber_hor))
        # return outputs if you have them; here I try it for you:
        return meshNumber_ver, meshNumber_hor
# ---------- end mesh_number ----------
control_polygon = ControlPolygon(Curve=render_diamond_array.LB_temprender)  # -> Polygon, Points
panel_9 = Panel(gencumulativeskymtx.readMe)
construct_point = ConstructPoint(
    XCoordinate=Slider(-1400, range=-1500..190),
    YCoordinate=Slider(-6000, range=-8000..4000),
    ZCoordinate=Slider(14, range=0..100))
mesh_plane = MeshPlane(Boundary=control_polygon.Polygon, WidthCount=mesh_number.meshNumber_hor, HeightCount=mesh_number.meshNumber_ver)  # -> Mesh, Area
legendpar = Ladybug_LegendParameters(
    decimalPlaces=Slider(4, range=0..6),
    legendLocation=construct_point,
    legendScale=Slider(0.01, range=0..10),
    fontSize=Slider(100, range=0..100))  # -> legendPar; plug-in component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
selectskymtx = Ladybug_selectSkyMtx(
    cumulativeSkyMtx=gencumulativeskymtx.cumulativeSkyMtx,
    analysisPeriod=analysisperiod.analysisPeriod,
    removeDiffuse=Toggle(False),
    removeDirect=Toggle(False))  # -> readMe, selectedSkyMtx; plug-in component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
mesh_flip = MeshFlip(Mesh=mesh_plane.Mesh)
boolean_toggle_2 = BooleanToggle(True)
point = Point(Point(8638.094015, 3329.922026, 0))
number = Number(0.01)
skydome = Ladybug_SkyDome(
    north=multiplication,
    selectedSkyMtx=selectskymtx.selectedSkyMtx,
    centerPoint=point,
    scale=number,
    showTotalOnly=False,
    runIt=Toggle(False),
    bakeIt=False)  # -> readMe, skyPatchesMesh, baseCrvs, legend, legendBasePts, skyPatchesCenPts, skyPatchesAreas, skyPatchesAsBrep, values; plug-in component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
construct_point_2 = ConstructPoint(XCoordinate=15000, YCoordinate=0, ZCoordinate=6000)
radiationanalysis = Ladybug_RadiationAnalysis(
    north=multiplication,
    geometry=flatten(mesh_flip),
    context=flatten([cont_surf, horizon]),
    disFromBase=Slider(0.5, range=-1..1),
    selectedSkyMtx=flatten(selectskymtx.selectedSkyMtx),
    legendPar=flatten(legendpar),
    parallel=Toggle(True),
    runIt=boolean_toggle_2,
    workingDir=boolean_toggle_2,
    projectName="testproject_01")  # -> readMe, contextMesh, analysisMesh, testPts, testVec, port, radiationResult, radiationMesh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; plug-in component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
panel_10 = Panel(radiationanalysis.readMe)
screen_oriented_mesh = ScreenOrientedMesh(Mesh=radiationanalysis.radiationLegend, Location=construct_point_2, SizeFactor=1, Depth=1, Absolute=True)

panel_11 = Panel(gencumulativeskymtx.cumulativeSkyMtx)
panel_12 = Panel(selectskymtx.readMe)
panel_13 = Panel(selectskymtx.selectedSkyMtx)
mesh = Mesh(mesh_flip)
surface = Surface(render_room_2.AdiabaticSurfaces)
surface_2 = Surface(render_room_2.WallF_PV)
surface_3 = Surface(render_room_2.WallF_W)
panel_14 = Panel(render_diamond_array.LB_temprender)
surface_4 = Surface(render_room_2.WallG)

python_script_7 = PythonScript(
    gridSize=python_script_6.WindowGridSize,
    room_width=python_script_6.room_width,
    room_height=python_script_6.room_height,
    glazing_w=python_script_6.glazing_percentage_w,
    glazing_h=python_script_6.glazing_percentage_h)  # -> WidthCount, HeightCount
# ---------- python_script_7: Python ----------
print gridSize

WidthCount = round((glazing_w * room_width)/gridSize)
HeightCount = round((glazing_h * room_height)/gridSize)

print WidthCount
print HeightCount
# ---------- end python_script_7 ----------
# Ladybug Window Analysis
mesh_plane_2 = MeshPlane(Boundary=surface_4, WidthCount=python_script_7.HeightCount, HeightCount=python_script_7.WidthCount)  # -> Mesh, Area
panel_15 = Panel([python_script_7.HeightCount, python_script_7.WidthCount])
boolean_toggle_3 = BooleanToggle(True)
mesh_flip_2 = MeshFlip(Mesh=mesh_plane_2.Mesh)
radiationanalysis_2 = Ladybug_RadiationAnalysis(
    north=multiplication,
    geometry=flatten(mesh_flip_2),
    context=flatten([cont_surf, mesh, horizon]),
    disFromBase=Slider(0.5, range=-1..1),
    selectedSkyMtx=flatten(selectskymtx.selectedSkyMtx),
    legendPar=flatten(legendpar),
    parallel=Toggle(True),
    runIt=boolean_toggle_3,
    workingDir=boolean_toggle_3,
    projectName="testproject_01")  # -> readMe, contextMesh, analysisMesh, testPts, testVec, port, radiationResult, radiationMesh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; plug-in component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
mesh_2 = Mesh(radiationanalysis_2.analysisMesh)
point_list = PointList(Points=radiationanalysis_2.testPts)
panel_16 = Panel(radiationanalysis_2.readMe)

panel_17 = Panel(radiationanalysis.totalRadiation)
houriterationnumber = Integer(python_script_2.hour)
panel_18 = Panel(radiationanalysis.radiationResult)

# ----
# Save Radiation Results ASF
panel_19 = Panel("radiation_results")
set_radiation_data_path = PythonScript(radData="RadiationData", runWhenChanged=boolean_toggle_2, folder_name=panel_19, DataNamePV=python_script.DataName)  # -> out, file_path
# ---------- set_radiation_data_path: Python ----------
#Save Temperature from .epw weather file

import sys, os
import datetime

# assign destination:
file_path = ghenv.Component.OnPingDocument().FilePath
asf_folder = '\\'.join(file_path.split('\\')[0:-1])

file_path = os.path.join(asf_folder , str(radData) + '\\' + str(folder_name) + '_' + DataNamePV)+'\\'

print file_path
# ---------- end set_radiation_data_path ----------
copylayoutandcomb = PythonScript(Iteration=houriterationnumber, destination=set_radiation_data_path.file_path)
# ---------- copylayoutandcomb: Python ----------
#06.01.2016
#Jeremias Schmidli
#Python script to produce a python file with ASF layout and combination parameters for post processing

from shutil import copyfile

if Iteration == 0 or Iteration == 1:
    # assign destination:
    file_path = ghenv.Component.OnPingDocument().FilePath
    current_folder = '\\'.join(file_path.split('\\')[0:-1])
    src = current_folder + "\data\grasshopper\LayoutAndCombinations.txt"
    
    dst = destination + 'LayoutAndCombinations.txt'
    copyfile(src, dst)
    print dst

pass
# ---------- end copylayoutandcomb ----------

panel_20 = Panel(set_radiation_data_path.file_path)
c_script = CSharpScript(
    HourIterationNumber=houriterationnumber,
    x_angle=python_script_2.x_angle,
    y_angle=python_script_2.y_angle,
    hourOfMonth=python_script_2.hour,
    day=python_script_2.day,
    month=python_script_2.month,
    totalRadiation=radiationanalysis.totalRadiation,
    panelSize=generate_diamond_array.panelSize,
    radiationPerPanel=radiationanalysis.radiationResult,
    path=set_radiation_data_path.file_path,
    fileName="RadiationResults")  # -> out, A; inputs HourIterationNumber: Int32, CombIterationNumber: Int32, x_angle: Double, y_angle: Double, hourOfMonth: Int32, day: Int32, month: Int32, totalRadiation: Double, panelSize: Double, radiationPerPanel: tree of Double, path: String, fileName: String
# ---------- c_script: C# ----------
    //
    // write text file
    //

    List<string> allLines = new List<string>();

    allLines.Add("total_radiation_(kWh per year)");
    allLines.Add(totalRadiation.ToString());
    allLines.Add("panel size");
    allLines.Add(panelSize.ToString());
    allLines.Add("Hour iteration number, Combination iteration number,  hour of month , month, total Radiation");
    allLines.Add(HourIterationNumber.ToString() + ',' + CombIterationNumber.ToString() + ',' + hourOfMonth.ToString() + ',' + month.ToString() + ',' + totalRadiation.ToString());



    allLines.Add("radiation of each grid point (kWh/m² per year, one panel per line)");
    int fieldsPerPanel = radiationPerPanel.Branches[0].Count;
    for(int i = 0; i < radiationPerPanel.BranchCount; i++)
    {
      fieldsPerPanel = radiationPerPanel.Branches[i].Count;
      string radPerPanel = "";
      for (int t = 0; t < fieldsPerPanel - 1; t++)
      {
        radPerPanel += radiationPerPanel.Branches[i][t].ToString() + ",";
      }
      int ti = fieldsPerPanel - 1;
      radPerPanel += radiationPerPanel.Branches[i][ti].ToString();
      allLines.Add(radPerPanel);
    }

    string file = path + fileName + "_" + HourIterationNumber.ToString() + "_" + day.ToString() + "_" + month.ToString() + "_" + x_angle.ToString() + "_" + y_angle.ToString() + ".csv";
    System.IO.File.WriteAllLines(file, allLines);

    //
    // save screenshot
    //

    // get viewport, create bitmap object, save to file

    //Rhino.Display.RhinoView myView = Rhino.RhinoDoc.ActiveDoc.Views.ActiveView;
    //Bitmap myBitmap = myView.CaptureToBitmap();
    //myBitmap.Save(pngPath);
# ---------- end c_script ----------
# Save Radiation Results Window
panel_21 = Panel("RadiationWall")

set_radiation_data_path_2 = PythonScript(
    radData="RadiationData",
    runWhenChanged=boolean_toggle_3,
    folder_name="radiation_wall",
    DataNameWin=python_script.DataName)  # -> out, file_path
# ---------- set_radiation_data_path_2: Python ----------
#Save Temperature from .epw weather file

import sys, os
import datetime

# assign destination:
file_path = ghenv.Component.OnPingDocument().FilePath
asf_folder = '\\'.join(file_path.split('\\')[0:-1])

file_path = os.path.join(asf_folder ,  str(radData) + '\\'+ str(folder_name) + '_' + DataNameWin)+'\\'

print file_path
# ---------- end set_radiation_data_path_2 ----------
copylayoutandcomb_2 = PythonScript(Iteration=houriterationnumber, destination=set_radiation_data_path_2.file_path)  # same code as copylayoutandcomb
c_script_2 = CSharpScript(
    HourIterationNumber=houriterationnumber,
    x_angle=python_script_2.x_angle,
    y_angle=python_script_2.y_angle,
    hourOfMonth=python_script_2.hour,
    day=python_script_2.day,
    month=python_script_2.month,
    totalRadiation=radiationanalysis_2.totalRadiation,
    panelSize=python_script_5.panelHeight,
    radiationPerPanel=radiationanalysis_2.radiationResult,
    path=set_radiation_data_path_2.file_path,
    fileName=panel_21)  # -> out, A; inputs HourIterationNumber: Int32, CombIterationNumber: Int32, x_angle: Double, y_angle: Double, hourOfMonth: Int32, day: Int32, month: Int32, totalRadiation: Double, panelSize: Double, radiationPerPanel: tree of Double, path: String, fileName: String
# ---------- c_script_2: C# ----------
    //
    // write text file
    //

    List<string> allLines = new List<string>();

    allLines.Add("total_radiation_(kWh per year)");
    allLines.Add(totalRadiation.ToString());
    allLines.Add("panel size");
    allLines.Add(panelSize.ToString());
    allLines.Add("X-Angle, Y-Angle, Hour iteration number, Combination iteration number,  hour of month , month, total Radiation");
    allLines.Add(x_angle.ToString() + ',' + y_angle.ToString() + ',' + HourIterationNumber.ToString() + ',' + CombIterationNumber.ToString() + ',' + hourOfMonth.ToString() + ',' + month.ToString() + ',' + totalRadiation.ToString());





    string file = path + fileName + "_" + HourIterationNumber.ToString() + "_" + day.ToString() + "_" + month.ToString() + "_" + x_angle.ToString() + "_" + y_angle.ToString() + ".csv";
    System.IO.File.WriteAllLines(file, allLines);

    //
    // save screenshot
    //

    // get viewport, create bitmap object, save to file

    //Rhino.Display.RhinoView myView = Rhino.RhinoDoc.ActiveDoc.Views.ActiveView;
    //Bitmap myBitmap = myView.CaptureToBitmap();
    //myBitmap.Save(pngPath);
# ---------- end c_script_2 ----------

panel_22 = Panel(set_radiation_data_path_2.file_path)
